# Grasshopper definition 20160413_COLOR BUNDLING.gh (Grasshopper 0.9.76)
# plug-ins: Anemone, Noise 4D

pt = Point(Point(0.6371048892, 0.331005476, 0))
panel = Panel("ambient")
rectangle = Rectangle(Plane=pt, XSize=Slider(150, range=100..400), YSize=Slider(150, range=100..400), Radius=0)  # -> Rectangle, Length
mplane = MeshPlane(Boundary=rectangle.Rectangle, WidthCount=Slider(25, range=10..60), HeightCount=Slider(16, range=10..30))  # -> Mesh, Area
# color mesh generation
number_slider = Slider(0.0313, range=0..0.1)
demesh = DeconstructMesh(Mesh=mplane.Mesh)  # -> Vertices, Faces, Colours, Normals
# WORKSHOP NAME
# DATE
# PLACE
number_slider_2 = Slider(23.36, range=0..40)
perlin = PerlinNoise(Values=demesh.Vertices, Time=Slider(2.7, range=0..10), Scale=number_slider)
gradient = Gradient(LowerLimit="-1", UpperLimit=1, Parameter=perlin, stops=[0: RGB(255, 255, 255), 0.672: RGB(0, 0, 0)])
multiplication = Multiplication(A=perlin, B=number_slider_2)
amp = Amplitude(Vector=demesh.Normals, Amplitude=multiplication)
move = Move(Geometry=demesh.Vertices, Motion=amp)  # -> Geometry, Transform
conmesh = ConstructMesh(Vertices=move.Geometry, Faces=demesh.Faces, Colours=gradient)

medges = MeshEdges(Mesh=conmesh)  # -> NakedEdges, InteriorEdges, NonManifoldEdges
crv = Curve(medges.NakedEdges)
join = JoinCurves(Curves=crv, Preserve=False)

divide = DivideCurve(Curve=join, Count=Slider(15, range=0..40), Kinks=False)  # -> Points, Tangents, Parameters
jitter = Jitter(List=divide.Points, Jitter=1, Seed=Slider(5, range=0..10))  # -> simplify(Values), Indices

prox = Proximity3D(Points=jitter.Values, Group=5, MinRadius=Slider(168, range=0..315), MaxRadius=Slider(188, range=0..400))  # -> flatten(Links), Topology

# ---- group: Random lines on a circle
cir = Circle(Plane=PlaneXY(0, 0, 0), Radius=Slider(50, range=0..100))
divide_2 = DivideCurve(Curve=cir, Count=Slider(50, range=0..100), Kinks=False)  # -> Points, Tangents, Parameters
jitter_2 = Jitter(List=divide_2.Points, Jitter=1, Seed=2)  # -> Values, Indices
dispatch = Dispatch(List=jitter_2.Values, DispatchPattern=[True, False])  # -> ListA, ListB
ln = Line(StartPoint=dispatch.ListA, EndPoint=dispatch.ListB)

# ----
number_slider_3 = Slider(25, range=0..100)
divide_3 = DivideCurve(Curve=prox.Links, Count=number_slider_3, Kinks=False)  # -> simplify(Points), Tangents, Parameters

tstat = TreeStatistics(Tree=divide_3.Points)  # -> Paths, Length, Count
vec = VectorXYZ(XComponent=0, YComponent=0, ZComponent=0)  # -> Vector, Length
repeat = RepeatData(Data=vec.Vector, Length=tstat.Length)  # -> simplify(Data)

# ---- group: Divide the lines
divlength = DivideLength(Curve=ln, Length=Slider(2, range=0.1..10))  # -> Points, Tangents, Parameters
lng = ListLength(List=divlength.Points)  # -> flatten(Length)
divide_4 = DivideCurve(Curve=ln, Count=lng, Kinks=False)  # -> Points, Tangents, Parameters

# ----
loop_start = LoopStart(Repeat=Slider(50, range=0..800), Data_0=simplify(divide_3.Points))  # -> port, Counter, Data_0
geo = Geometry(loop_start.Data_0)
pt_2 = Point(flatten(loop_start.Data_0))

mesh = Mesh(conmesh)
number_slider_4 = Slider(14, range=0..50)
number_slider_5 = Slider(1, range=0..1)
demesh_2 = DeconstructMesh(Mesh=mesh)  # -> Vertices, Faces, Colours, Normals
list = ValueList({"follow white": 0, "Follow black": 1}, selected="follow white")
cps = ClosestPoints(Point=flatten(pt_2), Cloud=demesh_2.Vertices, Count=Slider(12, range=0..100))  # -> ClosestPoint, simplify(CPIndex), Distance
panel_2 = Panel(list)
cluster = Cluster(
    agents=pt_2,
    index_of_visible=cps.CPIndex,
    M=mesh,
    intensity=Slider(0.8, range=0..1),
    treshold_limit_value_to_follow=Slider(1, range=0..1),
    b_1_w_0=panel_2)  # -> vector, elected_point

spring_stiffness = Slider(0.2, range=0..1)
rest_length = Slider(0.124, range=0..10)

# ---- group: Vectors
shift = ShiftList(List=reverse(geo), Shift=1, Wrap="0")  # -> reverse(List)
shift_2 = ShiftList(List=geo, Shift=1, Wrap="0")
vec2pt = Vector2Pt(PointA=shift_2, PointB=shift, Unitize=False)  # -> Vector, Length
subtraction = Subtraction(A=vec2pt.Length, B=rest_length)
unit = UnitVector(Vector=vec2pt.Vector)
multiplication_2 = Multiplication(A=unit, B=subtraction)
multiplication_3 = Multiplication(A=multiplication_2, B=spring_stiffness)

# ---- group: "clothed" points
shift_3 = ShiftList(List=loop_start.Data_0, Shift=1, Wrap="0")
shift_4 = ShiftList(List=reverse(shift_3), Shift=1, Wrap="0")  # -> reverse(List)

# ----
panel_3 = Panel(multiplication_2)

# ---- group: Last point from each line
item = ListItem(List=reverse(loop_start.Data_0), Index=0, Wrap=True)

# ---- group: First point from each line
item_2 = ListItem(List=loop_start.Data_0, Index=0, Wrap=True)

# ----
vdis = VectorDisplay(Anchor=shift_2, Vector=multiplication_2)
addition = Addition(A="1", B=number_slider_3)
partition = PartitionList(List=flatten(cluster.vector), Size=addition)  # -> simplify(Chunks)
panel_4 = Panel("""0
-1""")
vdis_2 = VectorDisplay(Anchor=pt_2, Vector=flatten(partition))
cull_i = CullIndex(List=partition, Indices=panel_4, Wrap=True)
vec_2 = Vector(partition)

# ---- group: Laplacian smoothing towards current closest points / Smoothing strength
number_slider_6 = Slider(0.226, range=0..1)

# ---- group: Vectors
panel_5 = Panel("0")
shift_5 = ShiftList(List=reverse(geo), Shift=1, Wrap=panel_5)
shift_6 = ShiftList(List=geo, Shift=1, Wrap=panel_5)  # -> reverse(List)
vec2pt_2 = Vector2Pt(PointA=shift_5, PointB=shift_6, Unitize=False)  # -> Vector, Length
unit_2 = UnitVector(Vector=vec2pt_2.Vector)

# ----
subtraction_2 = Subtraction(A=vec2pt_2.Length, B=rest_length)
multiplication_4 = Multiplication(A=subtraction_2, B=unit_2)

# ---- group: Vectors (continued)
multiplication_5 = Multiplication(A=spring_stiffness, B=multiplication_4)

# ----
vdis_3 = VectorDisplay(Anchor=shift_2, Vector=multiplication_4)

shift_7 = ShiftList(List=reverse(multiplication_3), Shift=1, Wrap=panel_5)  # -> reverse(List)
shift_8 = ShiftList(List=reverse(multiplication_5), Shift=1, Wrap=panel_5)

panel_6 = Panel(shift_8)

# ---- group: Move the "clothed" points by calculated spring vectors
addition_2 = Addition(A=simplify(shift_7), B=simplify(shift_8), C=simplify(cull_i))
move_2 = Move(Geometry=simplify(shift_4), Motion=addition_2)  # -> simplify(Geometry), Transform

# ---- group: Merge the "clothed" and "naked" points back into one list
merge = Merge(Data1=item_2, Data2=move_2.Geometry, Data3=item)

# ---- group: Laplacian smoothing towards current closest points
_5_is_an_ok_value_here = Panel("5")
flatten = FlattenTree(Tree=merge, Path="{0}")
prox_2 = Proximity3D(Points=flatten, Group=_5_is_an_ok_value_here)  # -> Links, Topology
item_3 = ListItem(List=flatten, Index=prox_2.Topology, Wrap=True)
avr = Average(Input=item_3)  # -> flatten(ArithmeticMean)
vec2pt_3 = Vector2Pt(PointA=flatten, PointB=avr, Unitize=False)  # -> Vector, Length
multiplication_6 = Multiplication(A=vec2pt_3.Vector, B=number_slider_6)
move_3 = Move(Geometry=flatten, Motion=multiplication_6)  # -> Geometry, Transform

# ----
vdis_4 = VectorDisplay(Anchor=flatten, Vector=vec2pt_3.Vector)

# ---- group: Fix the first point
unflatten = UnflattenTree(Tree=move_3.Geometry, Guide=merge)
item_4 = ListItem(List=merge, Index=0, Wrap=True)
replace = ReplaceItems(List=unflatten, Item=item_4, Indices="0", Wrap=False)

# ---- group: Fix the last point
item_5 = ListItem(List=reverse(merge), Index=0, Wrap=True)
replace_2 = ReplaceItems(List=reverse(replace), Item=item_5, Indices="0", Wrap=False)  # -> simplify(List)

# ----
loop_end = LoopEnd(port=loop_start.port, Exit=False, Data_0=replace_2, pausedState=False, state="Constant output")

# ---- group: Rebuild the curves
pline = PolyLine(Vertices=replace_2, Closed=False)

# ==== cluster Cluster
intensity = ClusterInput()
treshold_limit_value_to_follow = ClusterInput()
b_1_w_0 = ClusterInput()
index_of_visible = ClusterInput()
agents = ClusterInput()
M = ClusterInput()
num = Number(treshold_limit_value_to_follow)
num_2 = Number(intensity)
int = Integer(index_of_visible)
pt = Point(agents)
demesh = DeconstructMesh(Mesh=M)  # -> Vertices, Faces, Colours, Normals

color = ListItem(List=demesh.Colours, Index=int, Wrap=True)  # -> simplify(Item)
vertex = ListItem(List=demesh.Vertices, Index=int, Wrap=True)  # -> simplify(Item)

# ----
# using grayscale so each is the same
graysca = SplitARGB(Colour=color)  # -> Alpha, Red, Green, Blue

sort = SortList(Keys=graysca.Red, ValuesA=vertex)  # -> Keys, ValuesA
item = ListItem(List=sort.Keys, Index=0, Wrap=True)  # -> Item1, Item

item_2 = ListItem(List=sort.ValuesA, Index=0, Wrap=True)  # -> Item1, Item
panel = Panel("""follow color
i = black
-i = white""")

filter = StreamFilter(Gate=b_1_w_0, Stream0=item_2.Item1, Stream1=item_2.Item)

vec2pt = Vector2Pt(PointA=simplify(graft(pt)), PointB=filter, Unitize="true")  # -> flatten(Vector), Length
amp = Amplitude(Vector=vec2pt.Vector, Amplitude=num_2)
lng = ListLength(List=amp)
vec = Vector(Vector(0, 0, 0))
larger = LargerThan(FirstNumber=item.Item1, SecondNumber=num)  # -> flatten(LargerThan), OrEqualTo
repeat = RepeatData(Data=vec, Length=lng)
p_n_c = PickNChoose(Pattern=larger.LargerThan, Stream0=amp, Stream1=repeat)  # -> simplify(graft(Result))

vector = ClusterOutput(p_n_c)
elected_point = ClusterOutput(filter)
