# Grasshopper definition 20160414_COLOR BUNDLING.gh (Grasshopper 0.9.76)
# plug-ins: Anemone, Kangaroo Components, Weaverbird, Noise 4D

# ---- group: environment
# 15-17 April 2016
pt = Point(Point(0.6371048892, 0.331005476, 0))
rectangle = Rectangle(Plane=pt, XSize=Slider(150, range=100..400), YSize=Slider(150, range=100..400), Radius=0)  # -> Rectangle, Length
mplane = MeshPlane(Boundary=rectangle.Rectangle, WidthCount=Slider(25, range=10..60), HeightCount=Slider(16, range=10..30))  # -> Mesh, Area
demesh = DeconstructMesh(Mesh=mplane.Mesh)  # -> Vertices, Faces, Colours, Normals
perlin = PerlinNoise(Values=demesh.Vertices, Time=Slider(2.7, range=0..10), Scale=Slider(0.0288, range=0..0.1))
gradient = Gradient(LowerLimit="-1", UpperLimit=1, Parameter=perlin, stops=[0: RGB(255, 255, 255), 0.672: RGB(0, 0, 0)])
multiplication = Multiplication(A=perlin, B=Slider(23.36, range=0..40))
amp = Amplitude(Vector=demesh.Normals, Amplitude=multiplication)
move = Move(Geometry=demesh.Vertices, Motion=amp)  # -> Geometry, Transform
conmesh = ConstructMesh(Vertices=move.Geometry, Faces=demesh.Faces, Colours=gradient)

# ----
medges = MeshEdges(Mesh=conmesh)  # -> NakedEdges, InteriorEdges, NonManifoldEdges
crv = Curve(medges.NakedEdges)
join = JoinCurves(Curves=crv, Preserve=False)

# ----
# reciproCITY
# Alessio Erioli
# Aldo Sollazzo
# Eugenio Bettucchi
# DEFINITIONS BY
number_slider = Slider(25, range=0..40)
divide = DivideCurve(Curve=join, Count=number_slider, Kinks=False)  # -> Points, Tangents, Parameters
jitter = Jitter(List=divide.Points, Jitter=1, Seed=Slider(5, range=0..10))  # -> simplify(Values), Indices

prox = Proximity3D(Points=jitter.Values, Group=5, MinRadius=Slider(168, range=0..315), MaxRadius=Slider(188, range=0..400))  # -> flatten(Links), Topology
dupln = RemoveDuplicateLines(Lines=prox.Links, Tolerance=0.01)

divide_2 = DivideCurve(Curve=dupln, Count=Slider(25, range=0..100), Kinks=False)  # -> simplify(Points), Tangents, Parameters

exit = Button()
button = Button()
loop_start = LoopStart(Repeat=Slider(50, range=0..800), Trigger=button, Data=divide_2.Points)  # -> port, Counter, Data
panel = Panel(loop_start.Counter)

# ---- group: spring influence
spring_stiffness = Slider(0.1, range=0..1)
rest_length = Slider(0.124, range=0..10)

geo = Geometry(loop_start.Data)
pt_2 = Point(reverse(geo))
shift = ShiftList(List=geo, Shift="-1", Wrap=False)
shift_2 = ShiftList(List=geo, Shift=1, Wrap=False)
shift_3 = ShiftList(List=pt_2, Shift="-1", Wrap=False)
shift_4 = ShiftList(List=pt_2, Shift=1, Wrap=False)
vec2pt = Vector2Pt(PointA=shift_3, PointB=shift_4, Unitize=False)  # -> Vector, Length
vec2pt_2 = Vector2Pt(PointA=shift, PointB=shift_2, Unitize=False)  # -> Vector, Length
subtraction = Subtraction(A=vec2pt_2.Length, B=rest_length)
subtraction_2 = Subtraction(A=vec2pt.Length, B=rest_length)
amp_2 = Amplitude(Vector=vec2pt.Vector, Amplitude=subtraction_2)
amp_3 = Amplitude(Vector=vec2pt_2.Vector, Amplitude=subtraction)
multiplication_2 = Multiplication(A=spring_stiffness, B=amp_3)
multiplication_3 = Multiplication(A=spring_stiffness, B=amp_2)
shift_5 = ShiftList(List=multiplication_2, Shift=1, Wrap="false")
shift_6 = ShiftList(List=multiplication_3, Shift=1, Wrap="false")

# ---- group: "clothed" points
shift_7 = ShiftList(List=loop_start.Data, Shift=1, Wrap="false")
shift_8 = ShiftList(List=reverse(shift_7), Shift=1, Wrap="false")  # -> reverse(List)

# ---- group: endpoints
item = ListItem(List=reverse(loop_start.Data), Index=0, Wrap=True)
item_2 = ListItem(List=loop_start.Data, Index=0, Wrap=True)

# ----
mesh = Mesh(conmesh)

# ---- group: Laplacian smoothing towards current closest points / Smoothing strength
number_slider_2 = Slider(0.25, range=0..1)

# ---- group: seek color
mesh_2 = Mesh(conmesh)
number_slider_3 = Slider(1, range=0..1)
number_slider_4 = Slider(14, range=0..50)
demesh_2 = DeconstructMesh(Mesh=mesh_2)  # -> Vertices, Faces, Colours, Normals
list = ValueList({"follow white": 0, "Follow black": 1}, selected="follow white")
panel_2 = Panel(list)

pt_3 = Point(loop_start.Data)
number_slider_5 = Slider(12, range=0..100)
panel_3 = Panel("""0
-1""")
cloud = CloudDisplay(Points=demesh_2.Vertices, Colours=demesh_2.Colours, Size=Slider(3.259, range=0..5), SpriteType=0)

cps = ClosestPoints(Point=pt_3, Cloud=demesh_2.Vertices, Count=number_slider_5)  # -> ClosestPoint, simplify(CPIndex), Distance
cluster = Cluster(
    agents=pt_3,
    index_of_visible=cps.CPIndex,
    M=mesh_2,
    intensity=Slider(0.8, range=0..1),
    treshold_limit_value_to_follow=Slider(1, range=0..1),
    b_1_w_0=panel_2)  # -> vector, elected_point

vdis = VectorDisplay(Anchor=pt_3, Vector=cluster.vector)
cull_i = CullIndex(List=cluster.vector, Indices=panel_3, Wrap=True)

# ---- group: Move the "clothed" points by calculated spring vectors
addition = Addition(A=simplify(shift_5), B=simplify(shift_6), C=simplify(cull_i))
move_2 = Move(Geometry=simplify(shift_8), Motion=addition)  # -> Geometry, Transform

# ---- group: constrain on terrain
meshcp = MeshClosestPoint(Point=move_2.Geometry, Mesh=mesh)  # -> simplify(Point), Index, Parameter

# ---- group: Merge the "clothed" and "naked" points back into one list
merge = Merge(Data1=item_2, Data2=meshcp.Point, Data3=item)

# ---- group: Laplacian smoothing towards current closest points
_5_is_an_ok_value_here = Panel("5")
flatten = FlattenTree(Tree=merge, Path="{0}")
prox_2 = Proximity3D(Points=flatten, Group=_5_is_an_ok_value_here)  # -> Links, Topology
item_3 = ListItem(List=flatten, Index=prox_2.Topology, Wrap=True)
avr = Average(Input=item_3)  # -> flatten(ArithmeticMean)
vec2pt_3 = Vector2Pt(PointA=flatten, PointB=avr, Unitize=False)  # -> Vector, Length
multiplication_4 = Multiplication(A=vec2pt_3.Vector, B=number_slider_2)
move_3 = Move(Geometry=flatten, Motion=multiplication_4)  # -> Geometry, Transform

# ---- group: fix endpoints
item_4 = ListItem(List=reverse(merge), Index=0, Wrap=True)
unflatten = UnflattenTree(Tree=move_3.Geometry, Guide=merge)
item_5 = ListItem(List=merge, Index=0, Wrap=True)
replace = ReplaceItems(List=unflatten, Item=item_5, Indices="0", Wrap=False)
replace_2 = ReplaceItems(List=reverse(replace), Item=item_4, Indices="0", Wrap=False)  # -> simplify(List)

# ----
loop_end = LoopEnd(port=loop_start.port, Exit=exit, Data=simplify(replace_2), pausedState=False, state="Constant output", TimeOutVal=0)

# ---- group: re-sampling curves
resolution = Slider(16.01, range=1..20)
maxpoints = Slider(200, range=100..300)
pline = PolyLine(Vertices=loop_end, Closed=False)
mesh_3 = Mesh(conmesh)
wbcatmullclark = WeaverbirdsCatmullClarkSubdivision(MeshCurves=mesh_3, Level=1, SmoothNakedEdges=0)

# ----
len = Length(Curve=pline)
division = Division(A=len, B=resolution)
min = Minimum(A=division, B=maxpoints)
int = Integer(min)
divide_3 = DivideCurve(Curve=pline, Count=int, Kinks=False)  # -> Points, Tangents, Parameters

# ---- group: re-sampling curves (continued)
meshcp_2 = MeshClosestPoint(Point=divide_3.Points, Mesh=wbcatmullclark)  # -> simplify(Point), Index, Parameter
nurbs = NurbsCurve(Vertices=meshcp_2.Point, Degree=3, Periodic=False)  # -> Curve, Length, Domain
preview = CustomPreview(Geometry=nurbs.Curve, Shader=ColourSwatch(SwatchColor=RGB(25, 158, 176)))

# ==== cluster Cluster
agents = ClusterInput()
index_of_visible = ClusterInput()
M = ClusterInput()
intensity = ClusterInput()
treshold_limit_value_to_follow = ClusterInput()
b_1_w_0 = ClusterInput()
num = Number(treshold_limit_value_to_follow)
num_2 = Number(intensity)
int = Integer(index_of_visible)
pt = Point(agents)
demesh = DeconstructMesh(Mesh=M)  # -> Vertices, Faces, Colours, Normals

color = ListItem(List=demesh.Colours, Index=int, Wrap=True)
vertex = ListItem(List=demesh.Vertices, Index=int, Wrap=True)

# ----
# using grayscale so each is the same
graysca = SplitARGB(Colour=color)  # -> Alpha, Red, Green, Blue

sort = SortList(Keys=graysca.Red, ValuesA=vertex)  # -> Keys, ValuesA

panel = Panel("""follow color
i = black
-i = white""")
item = ListItem(List=sort.Keys, Index=0, Wrap=True)  # -> Item1, Item
item_2 = ListItem(List=sort.ValuesA, Index=0, Wrap=True)  # -> Item1, Item

filter = StreamFilter(Gate=b_1_w_0, Stream0=item_2.Item1, Stream1=item_2.Item)
pshift = ShiftPaths(Data=filter, Offset=-1)
elected_point = ClusterOutput(pshift)

larger = LargerThan(FirstNumber=item.Item1, SecondNumber=num)  # -> LargerThan, OrEqualTo
vec2pt = Vector2Pt(PointA=pt, PointB=pshift, Unitize="true")  # -> Vector, Length
amp = Amplitude(Vector=vec2pt.Vector, Amplitude=num_2)
lng = ListLength(List=amp)
vec = Vector(Vector(0, 0, 0))
repeat = RepeatData(Data=vec, Length=lng)  # -> simplify(Data)

pshift_2 = ShiftPaths(Data=larger.LargerThan, Offset=-1)

p_n_c = PickNChoose(Pattern=pshift_2, Stream0=amp, Stream1=repeat)

vector = ClusterOutput(p_n_c)
