# Grasshopper definition 20160414_DRONE DEPOSITION.gh (Grasshopper 0.9.76)
# Copyright: Co-de-iT
# plug-ins: MeshEdit Components, Anemone, Human, Kangaroo Components, Boid

# ----
# 15-17 April 2016
mesh = Mesh([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])
mjoin = MeshJoin(Meshes=mesh)
demesh = DeconstructMesh(Mesh=mjoin)  # -> Vertices, Faces, Colours, Normals
argb = SplitARGB(Colour=demesh.Colours)  # -> Alpha, Red, Green, Blue
pt = Point(demesh.Colours)
pdecon = Deconstruct(Point=pt)  # -> XComponent, YComponent, ZComponent
bnd = Bounds(Numbers=pdecon.ZComponent)
dedomain = DeconstructDomain(Domain=bnd)  # -> Start, End
gradient = Gradient(
    LowerLimit=dedomain.Start,
    UpperLimit=dedomain.End,
    Parameter=pdecon.ZComponent,
    stops=[0: RGB(255, 255, 255), 1: RGB(0, 0, 0)])
conmesh = ConstructMesh(Vertices=demesh.Vertices, Faces=demesh.Faces, Colours=gradient)

X = UnitX(Factor=1)

# ----
# reciproCITY
# Alessio Erioli
# Aldo Sollazzo
# Eugenio Bettucchi
# DEFINITIONS BY
number_slider = Slider(10, range=0..100)
crv = Curve(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)
pop2d = Populate2D(Region=crv, Count=number_slider, Seed=1)  # -> graft(Population)
lng = ListLength(List=flatten(pop2d))
repeat = RepeatData(Data=X, Length=lng)  # -> graft(Data)

pt_2 = ConstructPoint(XCoordinate=0, YCoordinate=0, ZCoordinate=0)
ln = Line(StartPoint=pt_2, EndPoint=pop2d)

merge = Merge(Data1=ln, Data2=repeat)  # -> simplify(Result)
number_slider_2 = Slider(80, range=0..1000)
group = Group(Objects=merge)
loop_start = LoopStart(Repeat=number_slider_2, Trigger=Button(), Data=simplify(group))  # -> port, Counter, simplify(Data)
panel = Panel(loop_start.Counter)

ungroup = Ungroup(Group=loop_start.Data)  # -> simplify(Objects)
item = ListItem(List=ungroup, Index=0, Wrap=True)  # -> Item, Item1
explode = Explode(Curve=item.Item, Recursive=True)  # -> Segments, Vertices
item_2 = ListItem(List=explode.Vertices, Index="-1", Wrap=True)  # -> simplify(Item)

tolerance_for_stop_follow_color = Slider(0.75, range=0..1)
follow_color = Slider(1, range=0..1)
max_vel = Slider(2, range=0..10)
closest_mesh_vertex = Slider(40, range=0..40)

vec = Vector(item.Item1)

# ---- group: desired position
amp = Amplitude(Vector=vec, Amplitude=Slider(4, range=0..10))
move = Move(Geometry=item_2, Motion=amp)  # -> Geometry, Transform

# ----
mesh_2 = Mesh(conmesh)
demesh_2 = DeconstructMesh(Mesh=mesh_2)  # -> Vertices, Faces, Colours, Normals

X_2 = UnitX(Factor=Slider(1.5, range=0..10))
lng_2 = ListLength(List=vec)
repeat_2 = RepeatData(Data=X_2, Length=lng_2)  # -> simplify(Data)

# ----
# FOLLOW MESH COLOR
pt_3 = Point(move.Geometry)
cps = ClosestPoints(Point=pt_3, Cloud=demesh_2.Vertices, Count=closest_mesh_vertex)  # -> simplify(ClosestPoint), CPIndex, Distance

color = ListItem(List=demesh_2.Colours, Index=cps.CPIndex, Wrap=True)  # -> simplify(Item)
vertex = ListItem(List=demesh_2.Vertices, Index=cps.CPIndex, Wrap=True)  # -> simplify(Item)

# ----
# using grayscale so each is the same
graysca = SplitARGB(Colour=color)  # -> Alpha, Red, Green, Blue

sort = SortList(Keys=graysca.Red, ValuesA=vertex)  # -> Keys, ValuesA, ValuesB
item_3 = ListItem(List=sort.Keys, Index=0, Wrap=True)  # -> Item1, Item

item_4 = ListItem(List=cps.ClosestPoint, Index=0, Wrap=True)
pt_4 = Point(simplify(item_4))
vec2pt = Vector2Pt(PointA=item_2, PointB=pt_4, Unitize=False)  # -> simplify(Vector), Length
maxforce = Slider(0.672, range=0..1)

item_5 = ListItem(List=sort.ValuesA, Index=0, Wrap=True)  # -> Item1, Item
panel_2 = Panel("""follow color
i = black
-i = white""")

# ----
# MOVE NORMAL TO MESH VERTEX
item_6 = ListItem(List=demesh_2.Normals, Index=cps.CPIndex, Wrap=True)
item_7 = ListItem(List=cps.Distance, Index=0, Wrap=True)
item_8 = ListItem(List=item_6, Index=0, Wrap=True)
treshold = Slider(4, range=0..10)
maxforce_2 = Slider(0.512, range=0..1)
smaller = SmallerThan(FirstNumber=item_7, SecondNumber=treshold)  # -> simplify(SmallerThan), OrEqualTo
steer = Steer(vel=vec, des=item_8, maxv=max_vel, maxf=maxforce_2)
vec_2 = Vector(Vector(0, 0, 0))
p_n_c = PickNChoose(Pattern=smaller.SmallerThan, Stream0=vec_2, Stream1=steer)

pt_5 = Point(pt_3)
vec2pt_2 = Vector2Pt(PointA=simplify(graft(pt_5)), PointB=item_5.Item1, Unitize="true")  # -> flatten(Vector), Length
amp_2 = Amplitude(Vector=vec2pt_2.Vector, Amplitude=follow_color)
lng_3 = ListLength(List=amp_2)
vec_3 = Vector(Vector(0, 0, 0))
larger = LargerThan(FirstNumber=item_3.Item1, SecondNumber=tolerance_for_stop_follow_color)  # -> flatten(LargerThan), OrEqualTo
repeat_3 = RepeatData(Data=vec_3, Length=lng_3)
p_n_c_2 = PickNChoose(Pattern=larger.LargerThan, Stream0=amp_2, Stream1=repeat_3)  # -> graft(Result)

# ----
# steer
steer_2 = Steer(vel=vec, des=vec2pt.Vector, maxv=max_vel, maxf=maxforce)

# ----
# acceleration
addition = Addition(A=simplify(steer_2), B=simplify(p_n_c_2), C=simplify(repeat_2), D=simplify(p_n_c))
multiplication = Multiplication(A=addition, B=Slider(0.25, range=0..1))
addition_2 = Addition(A=vec, B=multiplication)
trmvec = TrimVector(Vector=addition_2, LengthDomain=max_vel)
move_2 = Move(Geometry=item_2, Motion=trmvec)  # -> simplify(Geometry), Transform
ins = InsertItems(List=simplify(explode.Vertices), Item=move_2.Geometry, Indices="-1", Wrap=True)  # -> simplify(List)
pline = PolyLine(Vertices=ins, Closed=False)

merge_2 = Merge(Data1=simplify(pline), Data2=simplify(trmvec))
group_2 = Group(Objects=merge_2)

# ---- group: STEER LOGIC
move_3 = Move(Geometry=item_2, Motion=Vector(0, 0, 10))  # -> Geometry, Transform
amp_3 = Amplitude(Vector=vec2pt.Vector, Amplitude=max_vel)
vdis = VectorDisplay(Anchor=item_2)
vdis_2 = VectorDisplay(Anchor=item_2, Vector=amp_3)
vdis_3 = VectorDisplay(Anchor=move_3.Geometry, Vector=steer_2)

# ----
loop_end = LoopEnd(port=loop_start.port, Exit=False, Data=simplify(group_2), pausedState=False, state="Constant output", TimeOutVal=0)
ungroup_2 = Ungroup(Group=loop_end)

# ---- group: TRAIL
item_9 = ListItem(List=ungroup_2, Index=0, Wrap=True)

# ----
explode_2 = Explode(Curve=item_9, Recursive=True)  # -> Segments, simplify(Vertices)

# ---- group: calculate after loop end
equals = Equality(FirstNumber=number_slider_2, SecondNumber=panel)  # -> Equality, Inequality
gate = StreamGate(Stream=explode_2.Vertices, Gate=equals.Equality)  # -> Target0, Target1

# ----
duppt = RemoveDuplicatePts(Points=gate.Target1, Tolerance=0.01)

explode_3 = MeshExplode(Mesh=mjoin, Interpolate=False)
demesh_3 = DeconstructMesh(Mesh=explode_3)  # -> Vertices, Faces, Colours, Normals
avr = Average(Input=demesh_3.Vertices)  # -> flatten(ArithmeticMean)
lng_4 = ListLength(List=avr)
pt_6 = Point(flatten(duppt))
lng_5 = ListLength(List=pt_6)
vec_4 = Vector(Vector(0, 0, 0))
vec_5 = Vector(Vector(0, 0, 0))
repeat_4 = RepeatData(Data=vec_4, Length=lng_4)
repeat_5 = RepeatData(Data=vec_5, Length=lng_5)
dom = ConstructDomain(DomainStart=0, DomainEnd=Slider(10, range=0..10))
visible = FindVisibleAgents(
    AgentLocationPoint=avr,
    AgentMotionVector=repeat_4,
    LocationPointsOfTheFlock=pt_6,
    FlockMotionVectors=repeat_5,
    SearchDistance=dom,
    SearchAngle=Domain(0, 0))  # -> simplify(ListOfPoints), ListOfVectors, ListOfIndices

lng_6 = ListLength(List=visible.ListOfPoints)  # -> flatten(Length)

bnd_2 = Bounds(Numbers=lng_6)
dedomain_2 = DeconstructDomain(Domain=bnd_2)  # -> Start, End
gradient_2 = Gradient(
    LowerLimit=dedomain_2.Start,
    UpperLimit=dedomain_2.End,
    Parameter=lng_6,
    stops=[0: RGB(255, 255, 255), 0.735: RGB(0, 0, 0)])
conmesh_2 = ConstructMesh(Vertices=simplify(demesh_3.Vertices), Faces=simplify(demesh_3.Faces), Colours=graft(gradient_2))  # -> flatten(Mesh)
mjoin_2 = MeshJoin(Meshes=conmesh_2)
disjoint = DisjointMesh(Mesh=mjoin_2)
mblur = BlurMesh(Mesh=disjoint, Iterations=Slider(10, range=0..10))

smaller_2 = SmallerThan(FirstNumber=gradient_2, SecondNumber=Slider(2, range=0..2))  # -> SmallerThan, OrEqualTo
cull = CullPattern(List=graft(explode_3), CullPattern=graft(smaller_2.SmallerThan))
clean = CleanTree(RemoveNulls=True, RemoveInvalid=True, RemoveEmpty=True, Tree=cull)  # -> simplify(Tree)
mjoin_3 = MeshJoin(Meshes=flatten(clean))
weldvertices = MeshWeldVertices(Mesh=mjoin_3, Tolerance=0.01)  # -> RuntimeMessage, Mesh
demesh_4 = DeconstructMesh(Mesh=weldvertices.Mesh)  # -> Vertices, Faces, Colours, Normals

# ---- group: CUSTOM PROXIMITY
explode_4 = Explode(Curve=item_9, Recursive=True)  # -> Segments, simplify(Vertices)
dist = Slider(5, range=0..5)

# ----
tstat = TreeStatistics(Tree=explode_4.Vertices)  # -> Paths, Length, Count
flatten = FlattenTree(Tree=demesh_4.Vertices, Path="{0}")
item_10 = ListItem(List=tstat.Paths, Index=0, Wrap=True)
replace = ReplacePaths(Data=flatten, Search=item_10, Replace=tstat.Count)
merge_3 = Merge(Data1=explode_4.Vertices, Data2=replace)

# ---- group: CUSTOM PROXIMITY (continued)
cptree = ConnectPointTree(d=dist, Ptree=merge_3)  # -> out, P; inputs d: Double, Ptree: tree of Point3d
# ---------- cptree: C# ----------
    String eol = Environment.NewLine;
    Component.Name = "Connect Point tree";
    Component.NickName = "CPtree";
    Component.Message = "v0.1 _ by Alessio Erioli" + eol + "Co-de-iT";
    Component.Description = "Connects points in a tree"+eol+" excluding their own branch" + eol+
      "d - distance threshold";
    /*
    System.Threading.Tasks.Parallel.ForEach(Ptree.AllData(), p => {
    });
    */

    Point3d p, p1;

    // System.Collections.Concurrent.ConcurrentBag<Line> conn = new System.Collections.Concurrent.ConcurrentBag<Line>();
    DataTree<Point3d> conT = new DataTree<Point3d> ();

    //List <Line> conn = new List<Line>();
    GH_Path pa;
    //System.Threading.Tasks.Parallel.For(0, Ptree.BranchCount, i => {
    for (int i = 0; i < Ptree.BranchCount; i++){
      for(int r = 0; r < Ptree.Branch(i).Count; r++){
        p = Ptree.Branch(i)[r];
        pa = new GH_Path(new int[]{i,r});
        conT.EnsurePath(pa);
        for (int j = i + 1; j < Ptree.BranchCount; j++){
          for(int k = 0; k < Ptree.Branch(j).Count(); k++){
            p1 = Ptree.Branch(j)[k];
            if (p.DistanceTo(p1) < d){
              conT.Add(p1, pa);
              //conn.Add(new Line(p, p1));
            }
          }
        }
      }
    }
    //  });
    P = conT;
# ---------- end cptree ----------

# ----
prox = Proximity3D(Points=flatten(explode_4.Vertices), Group=5, MinRadius=Slider(3, range=0..10), MaxRadius=Slider(8, range=0..10))  # -> Links, Topology

# ---- group: CUSTOM PROXIMITY / POINT
lng_7 = ListLength(List=cptree.P)  # -> flatten(Length); disabled
bnd_3 = Bounds(Numbers=lng_7)  # disabled
dedomain_3 = DeconstructDomain(Domain=bnd_3)  # -> Start, End; disabled
gradient_3 = Gradient(LowerLimit=0, UpperLimit=dedomain_3.End, Parameter=lng_7, stops=[0: RGB(255, 255, 255), 1: RGB(0, 0, 0)])  # disabled
preview = CustomPreview(Geometry=flatten(explode_4.Vertices), Shader=gradient_3)  # disabled

# ---- group: CUSTOM PROXIMITY / CONNECTION
ln_2 = Line(StartPoint=simplify(graft(explode_4.Vertices)), EndPoint=cptree.P)  # -> flatten(Line)
len = Length(Curve=ln_2)
bnd_4 = Bounds(Numbers=len)
dedomain_4 = DeconstructDomain(Domain=bnd_4)  # -> Start, End
gradient_4 = Gradient(LowerLimit=0, UpperLimit=dedomain_4.End, Parameter=len, stops=[0: RGB(255, 255, 255), 1: RGB(0, 0, 0)])
previewlw = CustomPreviewLineweights(Geometry=ln_2, Shader=gradient_4)

# ----
len_2 = Length(Curve=ln_2)
bnd_5 = Bounds(Numbers=len_2)
dedomain_5 = DeconstructDomain(Domain=bnd_5)  # -> Start, End
gradient_5 = Gradient(
    LowerLimit=dedomain_5.Start,
    UpperLimit=dedomain_5.End,
    Parameter=len_2,
    stops=[0: RGB(47, 204, 183), 0.0913: RGB(153, 112, 112), 0.242: RGB(0, 4, 120)])
bar_graph = BarGraph(len_2, BarColor=RGB(255, 0, 90))
preview_2 = CustomPreview(Geometry=ln_2, Shader=gradient_5)

# ==== cluster Steer
maxf = ClusterInput()
vel = ClusterInput()
maxv = ClusterInput()
des = ClusterInput()
amp = Amplitude(Vector=des, Amplitude=maxv)
subtraction = Subtraction(A=amp, B=vel)
multiplication = Multiplication(A=subtraction, B=maxf)
vlen = VectorLength(Vector=multiplication)
min = Minimum(A=vlen, B=maxv)
amp_2 = Amplitude(Vector=multiplication, Amplitude=min)
acc = ClusterOutput(amp_2)
