# Grasshopper definition live class_01.gh (Grasshopper 0.9.76)
# plug-ins: Anemone, Boid, Noise 4D

pt = Point([<point referenced from the Rhino model> x7])
lng = ListLength(List=pt)
X = UnitX(Factor=1)
repeat = RepeatData(Data=X, Length=lng)
loop_start = LoopStart(N=Slider(47, range=0..100), D0=pt, D1=repeat)  # -> port, Counter, Data, Data_2
panel = Panel(loop_start.Counter)
random = Random(Range=Domain(0, 1), Number=Slider(3, range=0..10), Seed=loop_start.Counter)
item = ListItem(List=random, Index=0, Wrap=True)  # -> Item, Item1, Item2
vec = VectorXYZ(XComponent=item.Item, YComponent=item.Item1, ZComponent=item.Item2)  # -> Vector, Length
panel_2 = Panel(vec.Vector)
wander = RandomWander(
    AgentMotionVectors=loop_start.Data_2,
    AngleSpreadDomain=Domain(0, 3.141592654),
    RandomSeed=loop_start.Counter,
    AbsoluteMultiplier=1)
move = Move(Geometry=loop_start.Data, Motion=wander)  # -> Geometry, Transform
vdis = VectorDisplay(Anchor=loop_start.Data, Vector=vec.Vector)
loop_end = LoopEnd(
    port=loop_start.port,
    Exit=False,
    Data=simplify(move.Geometry),
    Data_2=simplify(wander),
    pausedState=False,
    state="Constant & Record",
    TimeOutVal=0)  # -> D0, D1

pt_2 = Point(<point referenced from the Rhino model>)
loop_start_2 = LoopStart(Repeat=Slider(2, range=0..10), Data=pt_2)  # -> port, Counter, Data
X_2 = UnitX(Factor=1)
pt_3 = Point(loop_start_2.Data)
move_2 = Move(Geometry=pt_3, Motion=X_2)  # -> Geometry, Transform
vdis_2 = VectorDisplay(Anchor=pt_3, Vector=X_2)
loop_end_2 = LoopEnd(port=loop_start_2.port, Exit=False, Data=move_2.Geometry, pausedState=False, state="Constant output", TimeOutVal=0)

pt_4 = Point(<point referenced from the Rhino model>)
pt_5 = Point(<point referenced from the Rhino model>)

# ---- group: agents loc
pt_6 = Point([<point referenced from the Rhino model> x6])

# ----
Z = UnitZ(Factor=Slider(2.95, range=0..10))
crv = Curve(<curve referenced from the Rhino model>)
lng_2 = ListLength(List=pt_6)
vec2pt = Vector2Pt(PointA=pt_5, PointB=pt_4, Unitize=False)  # -> Vector, Length

# ---- group: agents vel
repeat_2 = RepeatData(Data=Z, Length=lng_2)

# ----
move_3 = Move(Geometry=pt_5, Motion=vec2pt.Vector)  # -> Geometry, Transform
mplane = MeshPlane(Boundary=crv, WidthCount=Slider(67, range=2..100), HeightCount=Slider(64, range=2..100))  # -> Mesh, Area
merge = Merge(Data1=simplify(graft(pt_6)), Data2=simplify(graft(repeat_2)), Data3=simplify(graft(pt_6)))
demesh = DeconstructMesh(Mesh=mplane.Mesh)  # -> Vertices, Faces, Colours, Normals

# ---- group: goals
pt_7 = Point([<point referenced from the Rhino model> x3])

# ----
panel_3 = Panel(merge)
group = Group(Objects=merge)
perlin = PerlinNoise(Values=demesh.Vertices, Time=Slider(5.59, range=0..20), Scale=Slider(0.0082, range=0..0.1))
gradient = Gradient(LowerLimit="-1", UpperLimit=1, Parameter=perlin, stops=[0: RGB(255, 255, 255), 1: RGB(0, 0, 0)])
loop_start_3 = LoopStart(Repeat=Slider(131, range=0..300), Trigger=Button(), Data=group)  # -> port, Counter, Data
number_slider = Slider(2, range=1..3)
ungroup = Ungroup(Group=loop_start_3.Data)
split = SplitList(List=ungroup, Index=number_slider)  # -> ListA, ListB
conmesh = ConstructMesh(Vertices=demesh.Vertices, Faces=demesh.Faces, Colours=gradient)
item_2 = ListItem(List=split.ListA, Index=0, Wrap=True)  # -> Item, Item1

# ---- group: vel
vec_2 = Vector(item_2.Item1)

# ---- group: loc
pt_8 = Point(item_2.Item)

# ----
demesh_2 = DeconstructMesh(Mesh=conmesh)  # -> Vertices, Faces, Colours, Normals
pt_9 = Point(simplify(loop_end.D0))
flip = FlipMatrix(Data=simplify(pt_9))
viewer = ParamViewer(pt_9)
viewer_2 = ParamViewer(flip)
pline = PolyLine(Vertices=flip, Closed=False)

number_slider_2 = Slider(30, range=0..100)  # disabled
pop3d = Populate3D(Region={Plane=PlaneXY(0, 0, 0), X=Domain(0, 10), Y=Domain(0, 10), Z=Domain(0, 2)}, Count=number_slider_2, Seed=1)  # disabled
pt_10 = Point(pop3d)  # disabled
lng_3 = ListLength(List=pt_10)  # disabled
X_3 = UnitX(Factor=1)  # disabled
number_slider_3 = Slider(42, range=0..110)  # disabled
repeat_3 = RepeatData(Data=X_3, Length=lng_3)  # disabled
button = Button()  # disabled
loop_start_4 = LoopStart(N=number_slider_3, T=button, D0=pt_10, D1=repeat_3)  # -> port, Counter, Data, Data_2; disabled
number_slider_4 = Slider(2, range=0..10)  # disabled
number_slider_5 = Slider(0.5, range=0..1)  # disabled
avr = Average(Input=loop_start_4.Data)  # disabled
neg = Negative(Value=number_slider_4)  # disabled
number_slider_6 = Slider(14, range=0..100)  # disabled
number_slider_7 = Slider(1, range=0..1)  # disabled
pcharge = PointCharge(Point=avr, Charge=neg, Decay=number_slider_5)  # disabled
rad = Radians(Degrees=number_slider_6)  # disabled
number_slider_8 = Slider(0.5, range=0..1)  # disabled
mergef = MergeFields(Fields=pcharge)  # disabled
wander_2 = RandomWander(
    AgentMotionVectors=loop_start_4.Data_2,
    AngleSpreadDomain=rad,
    RandomSeed=loop_start_4.Counter,
    AbsoluteMultiplier=number_slider_7)  # disabled
evf = EvaluateField(Field=mergef, Point=loop_start_4.Data)  # -> Tensor, Strength; disabled
trmvec = TrimVector(Vector=evf.Tensor, LengthDomain=number_slider_8)  # disabled
number_slider_9 = Slider(0.4, range=0..1)  # disabled
swatch = ColourSwatch(SwatchColor=RGB(255, 0, 0))  # disabled
swatch_2 = ColourSwatch(SwatchColor=RGB(234, 255, 0))  # disabled
swatch_3 = ColourSwatch(SwatchColor=RGB(255, 255, 255))  # disabled
vdisex = VectorDisplayEx(Point=loop_start_4.Data, Vector=wander_2, Colour=swatch, Width=2)  # disabled

# ----
# s = d-v
number_slider_10 = Slider(0.08, range=0..0.1)  # disabled
# des
adhere = AhereToTheFlockCenter(
    AgentLocationPoint=loop_start_4.Data,
    LocationPointsOfTheFlock=loop_start_4.Data,
    SearchDistance=Domain(0, 0),
    ReferenceAgentsCount=-1,
    Multiplier=number_slider_10)  # disabled

addition = Addition(A=adhere, B=wander_2)  # disabled
trmvec_2 = TrimVector(Vector=addition, LengthDomain=number_slider_9)  # disabled
vdisex_2 = VectorDisplayEx(Point=loop_start_4.Data, Vector=addition, Colour=swatch_3, Width=2)  # disabled
vdisex_3 = VectorDisplayEx(Point=loop_start_4.Data, Vector=trmvec_2, Colour=swatch_2, Width=2)  # disabled
move_4 = Move(Geometry=loop_start_4.Data, Motion=addition)  # -> Geometry, Transform; disabled
loop_end_3 = LoopEnd(
    port=loop_start_4.port,
    Exit=False,
    Data=flatten(move_4.Geometry),
    Data_2=flatten(addition),
    pausedState=False,
    state="Constant & Record",
    TimeOutVal=0)  # -> D0, D1; disabled
flip_2 = FlipMatrix(Data=simplify(loop_end_3.D0))  # disabled
pline_2 = PolyLine(Vertices=flip_2, Closed=False)  # disabled
viewer_3 = ParamViewer(flip_2)  # disabled

max_vel = Slider(6.434, range=0..10)
amp = Amplitude(Vector=vec_2, Amplitude=Slider(5, range=0..5))

# ---- group: fut loc
move_5 = Move(Geometry=pt_8, Motion=amp)  # -> Geometry, Transform

# ----
cps = ClosestPoints(Point=move_5.Geometry, Cloud=pt_7, Count=Slider(2, range=1..3))  # -> ClosestPoint, CPIndex, Distance
avr_2 = Average(Input=cps.ClosestPoint)

cps_2 = ClosestPoints(Point=move_5.Geometry, Cloud=demesh_2.Vertices, Count=Slider(20, range=3..50))  # -> ClosestPoint, CPIndex, Distance
item_3 = ListItem(List=demesh_2.Colours, Index=cps_2.CPIndex, Wrap=True)
preview = CustomPreview(Geometry=cps_2.ClosestPoint, Shader=item_3)
ahsv = SplitAHSV(Colour=item_3)  # -> Alpha, Hue, Saturation, Value
sort = SortList(Keys=ahsv.Value, ValuesA=cps_2.ClosestPoint)  # -> Keys, ValuesA
panel_4 = Panel(ahsv.Value)
item_4 = ListItem(List=sort.ValuesA, Index=0, Wrap=True)  # -> Item1, Item

# ---- group: desired
vec2pt_2 = Vector2Pt(PointA=move_5.Geometry, PointB=item_4.Item1, Unitize=False)  # -> Vector, Length

# ---- group: acceleration
trmvec_3 = TrimVector(Vector=vec2pt_2.Vector, LengthDomain=max_vel)
max_force = Slider(0.179, range=0..1)
subtraction = Subtraction(A=trmvec_3, B=vec_2)
multiplication = Multiplication(A=subtraction, B=max_force)

# ----
addition_2 = Addition(A=vec_2, B=multiplication)
amp_2 = Amplitude(Vector=addition_2, Amplitude=max_vel)
trmvec_4 = TrimVector(Vector=addition_2, LengthDomain=max_vel)
move_6 = Move(Geometry=pt_8, Motion=amp_2)  # -> Geometry, Transform
meshcp = MeshClosestPoint(Point=move_6.Geometry, Mesh=conmesh)  # -> Point, Index, Parameter

# ---- group: uptdate trail
merge_2 = Merge(Data1=simplify(split.ListB), Data2=simplify(meshcp.Point))

# ----
merge_3 = Merge(Data1=simplify(meshcp.Point), Data2=simplify(amp_2), Data3=simplify(merge_2))
group_2 = Group(Objects=merge_3)
loop_end_4 = LoopEnd(port=loop_start_3.port, Exit=False, Data=simplify(group_2), pausedState=False, state="Constant output", TimeOutVal=0)
ungroup_2 = Ungroup(Group=loop_end_4)
split_2 = SplitList(List=ungroup_2, Index=number_slider)  # -> ListA, ListB
pt_11 = Point(split_2.ListB)
pline_3 = PolyLine(Vertices=split_2.ListB, Closed=False)
