# Grasshopper definition Octree subdiv.gh (Grasshopper 0.9.76)
# Copyright: Co-de-iT
# plug-ins: MeshEdit Components, Anemone, Topologizer, Human, Kangaroo Components

mesh = Mesh(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)
Y = UnitY(Factor="300")
move = Move(Geometry=mesh, Motion=Y)  # -> Geometry, Transform
Y_2 = UnitY(Factor="150")
Y_3 = UnitY(Factor="150")
crv = Curve(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)
move_2 = Move(Geometry=mesh, Motion=Y_2)  # -> Geometry, Transform
move_3 = Move(Geometry=crv, Motion=Y_3)  # -> Geometry, Transform
mesh_2 = Mesh(mesh)
crv_2 = Curve([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])
# simple octree subdiv
iterations = Slider(2, range=0..2)
demesh = DeconstructMesh(Mesh=move.Geometry)  # -> Vertices, Faces, Colours, Normals
demesh_2 = DeconstructMesh(Mesh=move_2.Geometry)  # -> Vertices, Faces, Colours, Normals
# conditional octree subdiv
number_slider = Slider(2, range=0..2)
demesh_3 = DeconstructMesh(Mesh=mesh_2)  # -> Vertices, Faces, Colours, Normals
# conditional octree subdiv - multiple curves
number_slider_2 = Slider(2, range=0..2)
scale = Scale(Geometry=graft(move.Geometry), Center=demesh.Vertices, Factor=0.5)  # -> simplify(Geometry), Transform
button = Button()
scale_2 = Scale(Geometry=graft(move_2.Geometry), Center=demesh_2.Vertices, Factor=0.5)  # -> simplify(Geometry), Transform
scale_3 = Scale(Geometry=graft(mesh_2), Center=demesh_3.Vertices, Factor=0.5)  # -> simplify(Geometry), Transform
previewlw = CustomPreviewLineweights(Geometry=move_3.Geometry, Shader=ColourSwatch(SwatchColor=RGB(255, 255, 255)), Thickness=3, Absolute=False)
previewlw_2 = CustomPreviewLineweights(Geometry=crv_2, Shader=ColourSwatch(SwatchColor=RGB(255, 255, 255)), Thickness=3, Absolute=False)
unifynormals = MeshUnifyNormals(Mesh=scale.Geometry)
unifynormals_2 = MeshUnifyNormals(Mesh=scale_2.Geometry)
unifynormals_3 = MeshUnifyNormals(Mesh=scale_3.Geometry)
fastloopstart = FastLoopStart(I=number_slider, D1=unifynormals_2)  # -> port, Counter, Data, Data_2
mcx = MeshCurve(Mesh=fastloopstart.Data_2, Curve=move_3.Geometry)  # -> Points, Faces
lng = ListLength(List=mcx.Points)
fastloopstart_2 = FastLoopStart(I=number_slider_2, D1=unifynormals_3)  # -> port, Counter, Data, Data_2
fastloopstart_3 = FastLoopStart(Iterations=iterations, Data=unifynormals)  # -> port, Counter, Data
equals = Equality(FirstNumber=lng, SecondNumber=0)  # -> Equality, Inequality
pshift = ShiftPaths(Data=equals.Equality, Offset=-1)
demesh_4 = DeconstructMesh(Mesh=fastloopstart_3.Data)  # -> Vertices, Faces, Colours, Normals
dispatch = Dispatch(List=fastloopstart.Data_2, DispatchPattern=pshift)  # -> ListA, ListB
mcx_2 = MeshCurve(Mesh=graft(fastloopstart_2.Data_2), Curve=crv_2)  # -> Points, Faces
scale_4 = Scale(Geometry=graft(fastloopstart_3.Data), Center=demesh_4.Vertices, Factor=0.5)  # -> simplify(Geometry), Transform
panel = Panel(pshift)
demesh_5 = DeconstructMesh(Mesh=dispatch.ListB)  # -> Vertices, Faces, Colours, Normals
lng_2 = ListLength(List=mcx_2.Points)
scale_5 = Scale(Geometry=graft(dispatch.ListB), Center=demesh_5.Vertices, Factor=0.5)  # -> simplify(Geometry), Transform
merge = Merge(Data1=fastloopstart.Data, Data2=dispatch.ListA)
fastloopend = FastLoopEnd(port=fastloopstart_3.port, Exit=False, Data=scale_4.Geometry, RecordData=False, TimeOutVal=0)
pshift_2 = ShiftPaths(Data=lng_2, Offset=-1)
ma = MassAddition(Input=pshift_2)  # -> Result, PartialResults
fastloopend_2 = FastLoopEnd(port=fastloopstart.port, Exit=False, Data=merge, Data_2=scale_5.Geometry, RecordData=False, TimeOutVal=0)  # -> D0, D1
equals_2 = Equality(FirstNumber=ma.Result, SecondNumber=0)  # -> Equality, Inequality
medges = MeshEdges(Mesh=fastloopend)  # -> NakedEdges, InteriorEdges, NonManifoldEdges
pshift_3 = ShiftPaths(Data=equals_2.Equality, Offset=-1)
lng_3 = ListLength(List=flatten(fastloopend_2.D1))
lng_4 = ListLength(List=flatten(fastloopend))
medges_2 = MeshEdges(Mesh=fastloopend_2.D0)  # -> NakedEdges, InteriorEdges, NonManifoldEdges
medges_3 = MeshEdges(Mesh=fastloopend_2.D1)  # -> NakedEdges, InteriorEdges, NonManifoldEdges
preview = CustomPreview(
    Geometry=fastloopend_2.D1,
    Shader={ambient=RGB(0, 0, 0), diffuse=RGB(255, 105, 180), emission=RGB(76, 32, 54), shine=0.5, specular=RGB(255, 255, 255), transparency=0})
previewlw_3 = CustomPreviewLineweights(Geometry=medges.InteriorEdges, Shader=ColourSwatch(SwatchColor=RGBA(0, 0, 0, 0)), Absolute=False)
preview_2 = CustomPreview(Geometry=fastloopend, Shader=ColourSwatch(SwatchColor=RGB(255, 255, 255)))
dispatch_2 = Dispatch(List=fastloopstart_2.Data_2, DispatchPattern=pshift_3)  # -> ListA, ListB
panel_2 = Panel(lng_4)
panel_3 = Panel(lng_3)
demesh_6 = DeconstructMesh(Mesh=dispatch_2.ListB)  # -> Vertices, Faces, Colours, Normals
previewlw_4 = CustomPreviewLineweights(Geometry=medges_2.InteriorEdges, Shader=ColourSwatch(SwatchColor=RGBA(0, 0, 0, 0)), Absolute=False)
panel_4 = Panel("""levels

start 8 elements
0 64
1 512
2 4096""")
viewer = ParamViewer(fastloopend_2.D1)
scale_6 = Scale(Geometry=graft(dispatch_2.ListB), Center=demesh_6.Vertices, Factor=0.5)  # -> simplify(Geometry), Transform
merge_2 = Merge(Data1=fastloopstart_2.Data, Data2=dispatch_2.ListA)
crv_3 = Curve(flatten([medges_3.InteriorEdges, medges_2.InteriorEdges]))
fastloopend_3 = FastLoopEnd(port=fastloopstart_2.port, Exit=False, Data=merge_2, Data_2=scale_6.Geometry, RecordData=False, TimeOutVal=0)  # -> D0, D1
dupln = RemoveDuplicateLines(Lines=crv_3, Tolerance=0.01)
topo = Topologizer(LinesInput=dupln, Tolerance=Slider(0.25, range=0..1))  # -> L, P, S, E, N, I, O, G; disabled
lng_5 = ListLength(List=flatten(fastloopend_3.D1))
medges_4 = MeshEdges(Mesh=fastloopend_3.D0)  # -> NakedEdges, InteriorEdges, NonManifoldEdges
medges_5 = MeshEdges(Mesh=fastloopend_3.D1)  # -> NakedEdges, InteriorEdges, NonManifoldEdges
preview_3 = CustomPreview(
    Geometry=fastloopend_3.D1,
    Shader={ambient=RGB(0, 0, 0), diffuse=RGB(255, 105, 180), emission=RGB(76, 32, 54), shine=0.5, specular=RGB(255, 255, 255), transparency=0})
# >16sec!!
crv_4 = Curve(topo.G)
panel_5 = Panel(lng_5)
previewlw_5 = CustomPreviewLineweights(Geometry=medges_4.InteriorEdges, Shader=ColourSwatch(SwatchColor=RGBA(0, 0, 0, 0)), Absolute=False)
viewer_2 = ParamViewer(fastloopend_3.D1)
crv_5 = Curve(flatten([medges_5.InteriorEdges, medges_4.InteriorEdges]))
dupln_2 = RemoveDuplicateLines(Lines=crv_5, Tolerance=0.01)
eval = EvaluateCurve(Curve=reparameterize(dupln_2), Parameter="0.5")  # -> Point, Tangent, Angle
topo_2 = Topologizer(LinesInput=dupln_2, Tolerance=Slider(0.25, range=0..1))  # -> L, P, S, E, N, I, O, G; disabled
crv_6 = Curve(topo_2.G)
viewer_3 = ParamViewer(topo_2.I)
number_slider_3 = Slider(9, range=0..20)
item = ListItem(List=topo_2.P, Index=number_slider_3, Wrap=True)
# >16sec!!
item_2 = ListItem(List=viewer_3, Index=number_slider_3, Wrap=True)
branch = TreeBranch(Tree=topo_2.I, Path=item_2, MaintainPaths=True)
item_3 = ListItem(List=topo_2.L, Index=branch, Wrap=True)
